# Dynamo custom node Categories.BuiltIn.Names.dyf (Dynamo 0.9.1.3071)
# category: Revit.Selection
# list of all the builtin category names

python_script = Python()
# ---------- python_script.python (5 lines) ----------
import clr
clr.AddReference('RevitAPI')
from Autodesk.Revit.DB import BuiltInCategory

OUT = filter(lambda i: "OST_" in i, dir(BuiltInCategory))
# ----------------------------------------
BuitIn_Categories = Output(python_script)
