# Dynamo custom node Categories.ByName.dyf (Dynamo 0.9.1.3071)
# category: Revit.Selection
# Returns Category(ies) from given Category name(s). Provide a string with value "All" to get all the Categories. (note: this is different from BuiltInCategory)

names = Input()
python_script = Python(IN[0]=names)
# ---------- python_script.python (24 lines) ----------
import clr
clr.AddReference('RevitAPI')
clr.AddReference("RevitServices")

from RevitServices.Persistence import DocumentManager

name = IN[0]

allCatsInDoc = DocumentManager.Instance.CurrentDBDocument.Settings.Categories

if not name or name == "All":
	category = allCatsInDoc
	
elif type(name) == list:
	catFilter = set(name)
	category = filter(lambda cat: cat.Name in catFilter, allCatsInDoc)
	
else:
	for cat in allCatsInDoc:
		if cat.Name == name:
			category = cat
			break
	
OUT = category
# ----------------------------------------
category = Output(python_script)
