# Dynamo custom node Elements.Element.SetParameterByNameIfExists.dyf (Dynamo 0.9.1.3071)
# category: Revit.Elements
# Sets the parameter by name if the element has the parameter

elements = Input()
parameterName = Input()
filterByParameterIfExists = Custom[Elements.Filter.ByParameterIfExists](elements=elements, parameterName=parameterName)  # seperates "elements with a parameter" from "elements without a parameter"
value = Input()
setParameterByName = Element.SetParameterByName(element=filterByParameterIfExists.elements_with_parameter, parameterName=parameterName, value=value)
elements_2 = Output(setParameterByName)  # "elements"
