# Dynamo custom node Elements.Filter.ByParameterIfExists.dyf (Dynamo 0.9.1.3071)
# category: Revit.Elements.Element
# seperates "elements with a parameter" from "elements without a parameter"

elements = Input()
parameterName = Input()
python_script = Python(IN[0]=elements, IN[1]=parameterName)
# ---------- python_script.python (24 lines) ----------
import clr
clr.AddReference('RevitAPI')
from Autodesk.Revit.DB import *

items = UnwrapElement(IN[0])
param = IN[1]
passed = list()
failed = list()
for item in items:
	try:
		flag = True
		for p in item.Parameters:
			if p.Definition.Name == param:
				passed.append(item)
				flag = False
				break
		if flag == True:
			failed.append(item)
	except:
		failed.append(item)

OUT = list()
OUT.append(passed)
OUT.append(failed)
# ----------------------------------------
extract_outputs = CodeBlock(outputs=python_script) { outputs[0]; outputs[1]; }
elements_with_parameter = Output(extract_outputs.out0)
elements_without_parameter = Output(extract_outputs.out1)  # "elements  without parameter"
