# Dynamo graph sample.dyn (Dynamo 0.9.1.3071)

# group: CCS Class Code for Types
# note: I used Google sheets to host a lookup table in CSV format. There should be two columns; first for the element type and second for CCSClassCode_Type.
# example:
# Walls,AD
# Columns,ULD
# It is best to create your CSV file in a spreadsheet editor to avoide syntax errors due to hidden whitespaces.
ccsclasscode_type_csv_file = CodeBlock { "https://goo.gl/vVF4x8"; }
web_request = WebRequest(ccsclasscode_type_csv_file)
parameter_name = StringInput("CCSClassCode_Type")
# note: To include elements of a specific type, add them to the "Include Only" box one item per line. List of Elements Types can be obtained from "Element Types" node.
include_only = StringInput("""WallType
FamilySymbol""")
python_script = Python(IN[0]=web_request, IN[1]=parameter_name, IN[2]=include_only)
# ---------- python_script.python (48 lines) ----------
import System

import clr
clr.AddReference('RevitAPI')
clr.AddReference("RevitServices")

from Autodesk.Revit.DB import FilteredElementCollector
from RevitServices.Persistence import DocumentManager
from RevitServices.Transactions import TransactionManager

# Get the document
doc = DocumentManager.Instance.CurrentDBDocument

# "Start" the transaction
TransactionManager.Instance.EnsureInTransaction(doc)

cats = doc.Settings.Categories

# lookup tabe accepts csv format such as: foo,bar
lookupTable = {line.split(",")[0]:line.split(",")[1] for line in IN[0].splitlines()}
param = IN[1]
typeLimit = None
try:
	typeLimit = set(IN[2].splitlines())
except:
	pass

modifiedElements = []
for cat in cats:
	if cat.Name not in lookupTable:
		continue
	collector = FilteredElementCollector(doc)
	collector.OfCategoryId(cat.Id)
	for item in collector.ToElements():
		if typeLimit and str(item.GetType()).split(".")[-1] not in typeLimit:
			continue
		try:
			for p in item.Parameters:
				if p.Definition.Name == param:
					p.Set(lookupTable[cat.Name])
					modifiedElements.append(item)
		except:
			pass
			
# "End" the transaction
TransactionManager.Instance.TransactionTaskDone()	

OUT = modifiedElements
# ----------------------------------------
modified_type_elements = Watch(python_script)
element_types = ElementTypes("WallType")

# group: CCS Location
levels = Levels("Level 0")
all_elements_at_level = ElementsAtLevel(levels)
parameter_name_2 = StringInput("CCSLocationID")
ccs_location_value = StringInput("+E118.S1")
setParameterByNameIfExists = Custom[Elements.Element.SetParameterByNameIfExists](elements=all_elements_at_level, parameterName=parameter_name_2, value=ccs_location_value)  # Sets the parameter by name if the element has the parameter
modified_elements = Watch(setParameterByNameIfExists)
